# Grasshopper definition PdS.gh (Grasshopper 0.9.76)
# plug-ins: WebSocketSharing

rayon_initial = Slider(13.9, range=0..50)
panel = Panel("""0
20
60
80
90
100""")
cir = Circle(Plane=PlaneXY(0, 0, 0), Radius=rayon_initial)
Z = UnitZ(Factor=panel)
move = Move(Geometry=cir, Motion=Z)  # -> Geometry, Transform
area = Area(Geometry=move.Geometry)  # -> Area, Centroid
panel_2 = Panel("""0.9
1.2
1.2
0.9
0.6
0.02""")
scale = Scale(Geometry=move.Geometry, Center=area.Centroid, Factor=panel_2)  # -> Geometry, Transform
loft = Loft(Curves=scale.Geometry, Options={Adjust=False, Closed=False, LoftEnds=0, LoftSimp=0, LoftType=0, Rebuild=10, Refit=0.01})
end = EndPoints(Curve=scale.Geometry)  # -> Start, End
nombre_de_segments = Slider(3, range=3..5)
intcrv = Interpolate(Vertices=end.Start, Degree=3, Periodic=False, KnotStyle=1)  # -> Curve, Length, Domain
epaisseur_du_trait = Slider(0.9, range=0.5..1.5)
nombre_d_étapes_de_courbures = Slider(15, range=5..22)
divide = DivideCurve(Curve=intcrv.Curve, Count=nombre_d_étapes_de_courbures, Kinks=False)  # -> Points, Tangents, Parameters
courbure_par_étape = Slider(0.08, range=0.05..0.2)
polygon = Polygon(Plane=divide.Points, Radius=epaisseur_du_trait, Segments=nombre_de_segments, FilletRadius=0)  # -> Polygon, Length
series = Series(Start=0, Step=courbure_par_étape, Count=nombre_d_étapes_de_courbures)
panel_3 = Panel(series)
_0 = Integer(0)
_360 = Integer(360)
rotate = Rotate(Geometry=polygon.Polygon, Angle=series, Plane=PlaneXY(0, 0, 0))  # -> Geometry, Transform
dom = ConstructDomain(DomainStart=_0, DomainEnd=_360)
loft_2 = Loft(Curves=rotate.Geometry, Options={Adjust=False, Closed=False, LoftEnds=0, LoftSimp=0, LoftType=0, Rebuild=10, Refit=0.01})
nombre_de_courbes = Slider(9, range=5..17)
panel_4 = Panel(dom)
range = Range(Domain=dom, Steps=nombre_de_courbes)
panel_5 = Panel(range)
rad = Radians(Degrees=range)
rotate_2 = Rotate(Geometry=loft_2, Angle=rad, Plane=PlaneXY(0, 0, 0))  # -> Geometry, Transform
mirror = Mirror(Geometry=rotate_2.Geometry, Plane=PlaneYZ(0, 0, 0))  # -> Geometry, Transform
résultat = Geometry([mirror.Geometry, rotate_2.Geometry, loft])
to_x_component = Slider(0, range=0..1)
from_x_component = Slider(0, range=0..1)
to_y_component = Slider(1, range=0..1)
to_z_component = Slider(0, range=0..1)
from_y_component = Slider(0, range=0..1)
from_z_component = Slider(1, range=0..1)
scale_factor = Slider(0.04, range=0..1)
scale_2 = Scale(Geometry=résultat, Center=Point(0, 0, 0), Factor=scale_factor)  # -> Geometry, Transform
vec = VectorXYZ(XComponent=to_x_component, YComponent=to_y_component, ZComponent=to_z_component)  # -> Vector, Length
vec_2 = VectorXYZ(XComponent=from_x_component, YComponent=from_y_component, ZComponent=from_z_component)  # -> Vector, Length
rotate_3 = Rotate(Geometry=scale_2.Geometry, Center=Point(0, 0, 0), From=vec_2.Vector, To=vec.Vector)  # -> Geometry, Transform
share_parameters = BooleanToggle(False)
connect = BooleanToggle(False)
send_mesh = BooleanToggle(False)
mesh = MeshBrep(
    Brep=rotate_3.Geometry,
    Settings={GridMaxCount=0, GridMinCount=16, JaggedSeams=False, MaxEdgeLength=0, MinEdgeLength=0.0001, MinTolerance=0, Refine=True, RefineAngle=0, RelativeTolerance=0.65, SimplePlanes=True, Tolerance=0})
websocketconnection = WebSocketConnection(Address="ws://169.254.27.174:8080/Grasshopper", Connect=connect)  # -> Status, Socket
flatten = FlattenTree(Tree=mesh, Path="{0}")
panel_6 = Panel(websocketconnection.Status)
websocketsharing = WebSocketSharing(
    Socket=websocketconnection.Socket,
    MeshStreaming=send_mesh,
    Meshes=flatten,
    ParameterSharing=share_parameters,
    SharedParameters=[rayon_initial, epaisseur_du_trait, courbure_par_étape, nombre_d_étapes_de_courbures, nombre_de_courbes])
panel_7 = Panel(websocketsharing)
