# Grasshopper definition hexagon-extruded-tutorial.gh (Grasshopper 0.9.76)
# plug-ins: MeshStreaming

outer_side_length = Slider(0.7, range=0..2)
server_url = Panel("ws://127.0.0.1:8080")
connect = BooleanToggle(False)
depth = Slider(0.5, range=0..2)
send = BooleanToggle(False)
hole_size = Slider(0.2, range=0..1)

pt = ConstructPoint(XCoordinate=0, YCoordinate=0, ZCoordinate=0)
xz = XZPlane(Origin=Point(0, 0, 0))
X = UnitX(Factor=outer_side_length)
rad = Radians(Degrees=Slider(60, range=0..100))
# Base hexagon
move = Move(Geometry=pt, Motion=X)  # -> Geometry, Transform
rotate = Rotate(Geometry=move.Geometry, Angle=rad, Plane=xz)  # -> Geometry, Transform
rotate_2 = Rotate(Geometry=rotate.Geometry, Angle=rad, Plane=xz)  # -> Geometry, Transform
rotate_3 = Rotate(Geometry=rotate_2.Geometry, Angle=rad, Plane=xz)  # -> Geometry, Transform
rotate_4 = Rotate(Geometry=rotate_3.Geometry, Angle=rad, Plane=xz)  # -> Geometry, Transform
rotate_5 = Rotate(Geometry=rotate_4.Geometry, Angle=rad, Plane=xz)  # -> Geometry, Transform
outer_hexagon = PolyLine(
    Vertices=[move.Geometry, rotate.Geometry, rotate_2.Geometry, rotate_3.Geometry, rotate_4.Geometry, rotate_5.Geometry],
    Closed=move.Geometry)

Y = UnitY(Factor=depth)
neg = Negative(Value=hole_size)
offset = Offset(Curve=outer_hexagon, Distance=neg, Plane=xz, Corners=1)
extr = Extrude(Base=outer_hexagon, Direction=Y)
Y_2 = UnitY(Factor=depth)
move_2 = Move(Geometry=offset, Motion=Y_2)  # -> Geometry, Transform
loft = Loft(
    Curves=[move_2.Geometry, offset],
    Options={Adjust=False, Closed=False, LoftEnds=0, LoftSimp=0, LoftType=0, Rebuild=10, Refit=0.01})
outside_geometry = CapHoles(Brep=extr)
inside_geometry = CapHoles(Brep=loft)
sdiff = SolidDifference(BrepsA=outside_geometry, BrepsB=inside_geometry)
mesh = MeshBrep(
    Brep=sdiff,
    Settings={GridMaxCount=0, GridMinCount=16, JaggedSeams=False, MaxEdgeLength=0, MinEdgeLength=0.0001, MinTolerance=0, Refine=True, RefineAngle=0, RelativeTolerance=0.65, SimplePlanes=True, Tolerance=0})
vec = VectorXYZ(XComponent=Slider(1, range=0..10), YComponent=Slider(2, range=0..10), ZComponent=Slider(1, range=0..10))  # -> Vector, Length
connectsocket = ConnectSocket(Address=server_url, Connect=connect)  # -> Status, Socket
connection_status = Panel(connectsocket.Status)
meshserialize = MeshSerialize(Mesh=mesh)
move_3 = Move(Geometry=mesh, Motion=vec.Vector)  # -> Geometry, Transform
meshserialize_2 = MeshSerialize(Mesh=move_3.Geometry)
integer_input = Slider(2, range=0..10)
float_input = Slider(0.4, range=0..1)
mesh_event_tag = Text("ghmesh")
input_event_tag = Text("ghinput")
bool_input = BooleanToggle(False)
sendmesh = SendMesh(Bytes=[meshserialize, meshserialize_2], Socket=connectsocket.Socket, Event_tag=mesh_event_tag, Send=send)  # -> Status, Length
text_input = Text("test text")
panel = Panel(sendmesh.Status)
externalinput = ExternalInput(
    Socket=connectsocket.Socket,
    EventName=input_event_tag,
    Active=Toggle(True),
    SharedInput=[outer_side_length, depth, hole_size])  # -> Status, ReceivedData
panel_2 = Panel(sendmesh.Length)
panel_3 = Panel(externalinput.ReceivedData)
panel_4 = Panel(externalinput.Status)
